# Dynamo graph GenerateConceptLineLoadsv3.dyn (Dynamo 3.3.0.6316)

code_block = CodeBlock { "Span Direction"; }
code_block_2 = CodeBlock { ["5_BO ROOF TRUSS-COORD-OVERALL AHG"]; }
python_script = Python(IN[0]=code_block_2)  # CPython3
# ---------- python_script.python (39 lines) ----------
import clr

# Revit API
clr.AddReference("RevitAPI")
from Autodesk.Revit.DB import FilteredElementCollector, View

# Dynamo-Revit plumbing
clr.AddReference("RevitServices")
from RevitServices.Persistence import DocumentManager

doc = DocumentManager.Instance.CurrentDBDocument

# ---------- Inputs ----------
# IN[0] = list of view name strings, e.g. ["Level 1 - Framing Plan", "Roof - Framing Plan"]
view_names = IN[0]

# ---------- Helpers ----------
def as_list(x):
    if x is None: return []
    return x if isinstance(x, (list, tuple)) else [x]

names = [str(vn).strip() for vn in as_list(view_names)]

# ---------- Main ----------
# Collect all non-template views in the model
all_views = FilteredElementCollector(doc).OfClass(View).ToElements()
views_by_name = {v.Name: v for v in all_views if not v.IsTemplate}

# Match input strings to actual views
matched_views = []
for name in names:
    view = views_by_name.get(name)
    if view:
        matched_views.append(view)
    else:
        # optional: print or store None if not found
        matched_views.append(None)

OUT = matched_views
# ----------------------------------------
python_script_pull_location_and = Python(IN[0]=code_block, IN[1]=python_script)  # "Python Script Pull Location and Loading Values"; CPython3
# ---------- python_script_pull_location_and.python (228 lines) ----------
# Revit / Dynamo Python: Find all instances by family name and build rotated span rectangles
# Ensures DEAD/LIVE/SNOW values are normalized to pounds per linear foot (plf)
import clr, math, re

# Revit API
clr.AddReference("RevitAPI")
from Autodesk.Revit.DB import FilteredElementCollector, StorageType

# Dynamo / Revit plumbing
clr.AddReference("RevitServices")
from RevitServices.Persistence import DocumentManager

# Dynamo geometry
clr.AddReference("ProtoGeometry")
from Autodesk.DesignScript.Geometry import Point as DSPoint, Line as DSLine

doc = DocumentManager.Instance.CurrentDBDocument

# ---------- Inputs ----------
# IN[0]: Family name string, e.g. "Span Direction"
# IN[1]: View or list of views
family_name = IN[0]
views_input = IN[1]

# ---------- Helpers ----------
try:
    Unwrap = UnwrapElement
except:
    def Unwrap(x): return x

def as_list(x):
    if x is None: return []
    return x if isinstance(x, (list, tuple)) else [x]

views = [Unwrap(v) for v in as_list(views_input)]

def get_param(elem, param_name):
    """Return (p, storage_type, as_double, as_string, as_value_string)."""
    p = elem.LookupParameter(param_name)
    if not p:
        return None, None, None, None, None
    st = p.StorageType
    as_double = p.AsDouble() if st == StorageType.Double else None
    as_string = p.AsString() if st == StorageType.String else None
    # AsValueString() often includes formatted units like '0.6 k/ft'
    try:
        as_value_string = p.AsValueString()
    except:
        as_value_string = None
    return p, st, as_double, as_string, as_value_string

_num_re = re.compile(r'[-+]?\d*\.?\d+(?:[eE][-+]?\d+)?')

def _parse_number(s):
    if not s: return None
    m = _num_re.search(s.replace(',', ''))
    return float(m.group(0)) if m else None

def to_plf(elem, param_name):
    """
    Normalize the given parameter to pounds per linear foot (plf).
    Strategy:
      - If Double and no unit text: assume already plf (Revit internal is lbf/ft for force/length).
      - If ValueString contains units:
          * 'k/ft', 'kips/ft', 'kip/ft' => convert k/ft -> plf (x1000) and apply sign
          * 'plf', 'lb/ft', 'lbf/ft'    => treat numeric as plf
          * OPTIONAL: 'N/m' => convert to plf (N/m * 0.0685217659)
      - If String contains a number + units, parse similarly.
      - If Integer, treat as plf.
    """
    p, st, as_double, as_string, as_value_string = get_param(elem, param_name)

    # Prefer a formatted display string if present (often includes units)
    txt = (as_value_string or as_string or "").strip().lower()

    # Case 1: formatted string with units
    if txt:
        n = _parse_number(txt)
        if n is not None:
            if 'k/ft' in txt or 'kip/ft' in txt or 'kips/ft' in txt:
                return n * 1000.0 * ( -1.0 if '-' in txt and n > 0 else 1.0 ) if False else n * 1000.0
            if 'plf' in txt or 'lb/ft' in txt or 'lbf/ft' in txt:
                return n
            if 'n/m' in txt:
                return n * 0.0685217659  # N/m -> lbf/ft
            # Fallback: if it’s just a number, assume plf
            return n

    # Case 2: numeric double with no explicit unit text -> assume plf
    if st == StorageType.Double and as_double is not None:
        return float(as_double)

    # Case 3: integer -> assume plf
    if st == StorageType.Integer and p is not None:
        try:
            return float(p.AsInteger())
        except:
            pass

    # Case 4: string with number but no units -> assume plf
    if as_string:
        n = _parse_number(as_string)
        if n is not None:
            return n

    return None

# --- Geometry helpers ---
def _rot2d(x, y, ang):
    ca, sa = math.cos(ang), math.sin(ang)
    return (x*ca - y*sa, x*sa + y*ca)

def is_y_flipped(fi, view):
    try:
        if getattr(fi, "FacingFlipped", False): return True
    except: pass
    try:
        if getattr(fi, "Mirrored", False): return True
    except: pass
    try:
        fo = getattr(fi, "FacingOrientation", None)
        up = getattr(view, "UpDirection", None)
        if fo and up and fo.DotProduct(up) < 0:
            return True
    except: pass
    return False

def rectangle_lines_from_spans(center_xyz, rotation_rad,
                               left_span, span_length, bot_span, top_span,
                               flip_y=False):
    # X extents after shifting by -left_span
    xL = 0.0
    xR = span_length
    # Y extents relative to center
    if flip_y:
        yB = -top_span
        yT =  bot_span
    else:
        yB = -bot_span
        yT =  top_span
    local_pts = [(xL, yB), (xR, yB), (xR, yT), (xL, yT)]
    cx, cy, cz = center_xyz.X, center_xyz.Y, center_xyz.Z
    world_pts = []
    for (lx, ly) in local_pts:
        rx, ry = _rot2d(lx, ly, rotation_rad)
        world_pts.append(DSPoint.ByCoordinates(cx + rx, cy + ry, cz))
    P0, P1, P2, P3 = world_pts
    return [
        DSLine.ByStartPointEndPoint(P0, P1),
        DSLine.ByStartPointEndPoint(P1, P2),
        DSLine.ByStartPointEndPoint(P2, P3),
        DSLine.ByStartPointEndPoint(P3, P0),
    ]

# ---------- Main ----------
results    = []   # matching elements
centers    = []   # element center points (DSPoint or None)
rectangles = []   # list of 4 DSLine per element (or None if cannot build)
output     = []   # [StartPoint, EndPoint, DEAD_plf, LIVE_plf, SNOW_plf, VIEW_NAME]

if family_name and views:
    for v in views:
        view_name = v.Name
        collector = FilteredElementCollector(doc, v.Id).WhereElementIsNotElementType()
        for e in collector:
            try:
                sym = doc.GetElement(e.GetTypeId())
                fam = sym.Family if sym else None
                if fam and fam.Name == family_name:
                    results.append(e)

                    # location (center) and rotation
                    loc = e.Location
                    pt_xyz = loc.Point if hasattr(loc, "Point") else None
                    rot    = getattr(loc, "Rotation", 0.0) or 0.0

                    # store center (as DSPoint for convenience)
                    centers.append(DSPoint.ByCoordinates(pt_xyz.X, pt_xyz.Y, pt_xyz.Z) if pt_xyz else None)

                    # required params
                    left_span  = to_plf(e, "Left Span")     # remains distances (ft) if those params are lengths
                    span_len   = to_plf(e, "Span Length")
                    bot_span   = to_plf(e, "Bot Span")
                    top_span   = to_plf(e, "Top Span")

                    # If span parameters are lengths, not loads, they should not go through to_plf.
                    # If yours are truly lengths, replace the four lines above with get_param(elem,..).AsDouble() pattern.
                    # Keeping original behavior for continuity with your setup:
                    def get_len(name):
                        _, st, ad, _, _ = get_param(e, name)
                        return float(ad) if (st == StorageType.Double and ad is not None) else None

                    left_span  = get_len("Left Span")
                    span_len   = get_len("Span Length")
                    bot_span   = get_len("Bot Span")
                    top_span   = get_len("Top Span")

                    # Normalize loads to plf
                    dead_plf = to_plf(e, "DEAD PLF")
                    live_plf = to_plf(e, "LIVE PLF")
                    snow_plf = to_plf(e, "SNOW PLF")

                    # Build rectangle only if everything is valid
                    if pt_xyz is not None and None not in (left_span, span_len, bot_span, top_span):
                        flip_y = is_y_flipped(e, v)
                        rect_edges = rectangle_lines_from_spans(
                            pt_xyz, rot, left_span, span_len, bot_span, top_span, flip_y=flip_y
                        )

                        # Edges: 0=bottom, 1=right, 2=top, 3=left
                        line_right = rect_edges[1]
                        line_left  = rect_edges[3]
                        r0, r1 = line_right.StartPoint, line_right.EndPoint
                        l0, l1 = line_left.StartPoint,  line_left.EndPoint

                        # Append both lines with load values (plf) and view name
                        output.append([r0, r1, dead_plf, live_plf, snow_plf, view_name])
                        output.append([l0, l1, dead_plf, live_plf, snow_plf, view_name])

                        rectangles.append(rect_edges)
                    else:
                        rectangles.append(None)
            except:
                # Silently skip elements that don't behave like family instances
                pass

# Outputs
OUT = rectangles, output
# ----------------------------------------
code_block_3 = CodeBlock { "Loading Data"; }
python_script_write_to_csv = Python(IN[0]=python_script_pull_location_and, IN[1]=code_block_3)  # CPython3
# ---------- python_script_write_to_csv.python (113 lines) ----------
# Dynamo Python: Write ONE Excel file (or one CSV fallback) with all rows + VIEW_NAME
import clr, os

# ----- Inputs -----
rows         = IN[0][1]   # list of [startPt, endPt, dead, live, snow, view_name]
out_dir      = r"C:\Users\aguter\OneDrive - QUINLIVAN PIERIK & KRAUSE - ARCHITECTS ENGINEERS\Desktop"
name_prefix  = IN[1] if len(IN) > 1 and IN[1] else "SpanLines"

# ----- Helpers -----
def ensure_dir(p):
    if not p:
        raise Exception("Output directory path is required.")
    if not os.path.exists(p):
        os.makedirs(p)

def pt_to_tuple(p):
    """Accepts DSPoint, Revit XYZ, or (x,y,z) iterable and returns (x,y,z) floats."""
    try:
        return (float(p.X), float(p.Y), float(p.Z))  # DSPoint / XYZ
    except:
        pass
    try:
        x, y, z = p
        return (float(x), float(y), float(z))
    except:
        return (None, None, None)

def try_excel_com_available():
    """Return (excel_app, ExcelModule) or (None, None) if COM not available."""
    try:
        clr.AddReference('Microsoft.Office.Interop.Excel')
        from Microsoft.Office.Interop import Excel
        app = Excel.ApplicationClass()
        app.Visible = False
        app.DisplayAlerts = False
        return app, Excel
    except:
        return None, None

def save_workbook(app, Excel, filepath, header, data_rows):
    """Create one workbook, write header, then many data rows, save as .xlsx."""
    wb = None
    try:
        wb = app.Workbooks.Add()
        ws = wb.ActiveSheet

        # Header
        for c, h in enumerate(header, 1):
            ws.Cells(1, c).Value2 = h

        # Data rows
        for r, data in enumerate(data_rows, 2):  # start at row 2
            for c, v in enumerate(data, 1):
                ws.Cells(r, c).Value2 = v

        wb.SaveAs(filepath)
    finally:
        if wb is not None:
            wb.Close(SaveChanges=False)

def save_csv(filepath, header, data_rows):
    """Fallback: write one CSV with header + all rows."""
    import csv
    with open(filepath, mode='w', newline='') as f:
        w = csv.writer(f)
        w.writerow(header)
        for row in data_rows:
            w.writerow(row)

# ----- Main -----
ensure_dir(out_dir)

header = [
    "Start X (ft)", "Start Y (ft)", "Start Z (ft)",
    "End X (ft)",   "End Y (ft)",   "End Z (ft)",
    "DEAD (plf)", "LIVE (plf)", "SNOW (plf)",
    "VIEW_NAME"
]

# Normalize all rows first
data_rows = []
for row in (rows or []):
    # Accept rows with or without view_name at end
    start_pt, end_pt, dead_plf, live_plf, snow_plf, view_name = (row + [None]*6)[:6]
    sx, sy, sz = pt_to_tuple(start_pt)
    ex, ey, ez = pt_to_tuple(end_pt)
    data_rows.append([sx, sy, sz, ex, ey, ez, dead_plf, live_plf, snow_plf, view_name])

# Single filename
xlsx_path = os.path.join(out_dir, "{}.xlsx".format(name_prefix))
csv_path  = os.path.join(out_dir, "{}.csv".format(name_prefix))

created_file = None
errors = []

excel_app, ExcelMod = try_excel_com_available()
try:
    if excel_app is not None:
        save_workbook(excel_app, ExcelMod, xlsx_path, header, data_rows)
        created_file = xlsx_path
    else:
        save_csv(csv_path, header, data_rows)
        created_file = csv_path
except Exception as e:
    errors.append(str(e))
finally:
    if excel_app is not None:
        try:
            excel_app.Quit()
        except:
            pass

OUT = created_file, errors
# ----------------------------------------
code_block_4 = CodeBlock { ["3_LEVEL 2-COORD-OVERALL AHG","4_LEVEL 3-COORD-OVERALL AHG", "5_BO ROOF TRUSS-COORD-OVERALL AHG", "6_LEVEL 4-COORD-OVERALL AHG"]; }
