# Dynamo graph Shearwall Locations to RAM Concept.dyn (Dynamo 3.3.0.6316)

categories = Categories("OST_StructuralFraming")
all_elements_of_category = ElementsOfCategory(Category=categories)
code_block = CodeBlock { "ATS Shearwall"; }
code_block_2 = CodeBlock { "Structural Framing"; }
byName = Category.ByName(name=code_block_2)
code_block_3 = CodeBlock { "ATS Shearwall"; }
python_script = Python(IN[0]=byName, IN[1]=code_block_3)  # CPython3
# ---------- python_script.python (37 lines) ----------
import clr
clr.AddReference('RevitServices')
from RevitServices.Persistence import DocumentManager
doc = DocumentManager.Instance.CurrentDBDocument

clr.AddReference('RevitAPI')
from Autodesk.Revit.DB import (
    FilteredElementCollector,
    FamilyInstance,
    ElementId
)

clr.AddReference('RevitNodes')
import Revit
clr.ImportExtensions(Revit.Elements)

# Inputs
category = IN[0]      # Dynamo Category
familyName = IN[1]    # string

# Convert Dynamo category Id (int) → Revit ElementId
catId = ElementId(category.Id)

# Collect all instances in the category
collector = (FilteredElementCollector(doc)
             .OfCategoryId(catId)
             .WhereElementIsNotElementType())

results = []

# Filter by family name
for el in collector:
    if isinstance(el, FamilyInstance):
        if el.Symbol.Family.Name == familyName:
            results.append(el.ToDSType(True))

OUT = results, category.Id, catId
# ----------------------------------------
python_script_2 = Python(IN[0]=python_script)  # CPython3
# ---------- python_script_2.python (60 lines) ----------
import clr

# Dynamo geometry
clr.AddReference('ProtoGeometry')
from Autodesk.DesignScript.Geometry import Point, Line

# Revit / Dynamo
clr.AddReference('RevitServices')
from RevitServices.Persistence import DocumentManager
doc = DocumentManager.Instance.CurrentDBDocument

clr.AddReference('RevitAPI')
from Autodesk.Revit.DB import FamilyInstance

clr.AddReference('RevitNodes')
import Revit
clr.ImportExtensions(Revit.Elements)

# ---- INPUTS ----
# IN[0] = list of family instances (from previous node)
elems_in = IN[0][0]
if not isinstance(elems_in, list):
    elems_in = [elems_in]

# unwrap to Revit API elements
elems = [UnwrapElement(e) for e in elems_in]

start_pts = []
lines = []
lengthSWs = []
for fi in elems:
    if not isinstance(fi, FamilyInstance):
        continue

    # Get length from "Length" parameter (internal units: feet)
    length_param = fi.LookupParameter("Shearwall Length")
    lengthSWs.append(length_param)
    if length_param is None:
        continue
    length = length_param.AsDouble()

    # Get instance transform (origin + local axes)
    t = fi.GetTransform()
    origin = t.Origin      # assumed START point
    direction = t.BasisX   # assumed along member axis

    # End point = origin + length * direction

    end_xyz = origin.Add(direction.Multiply(length))


    # Convert XYZ → Dynamo Points
    start_pt = Point.ByCoordinates(origin.X, origin.Y, origin.Z)
    end_pt   = Point.ByCoordinates(end_xyz.X, end_xyz.Y, end_xyz.Z)

    start_pts.append(start_pt)
    lines.append(Line.ByStartPointEndPoint(start_pt, end_pt))

# OUT: [list of start points, list of lines]
OUT = (start_pts, lines, elems, lengthSWs)
# ----------------------------------------
python_script_v2 = Python(IN[0]=python_script)  # CPython3; unwired: IN[1]
# ---------- python_script_v2.python (414 lines) ----------
import clr, os, re

# Dynamo geometry
clr.AddReference('ProtoGeometry')
from Autodesk.DesignScript.Geometry import Point, Line

# Revit / Dynamo
clr.AddReference('RevitServices')
from RevitServices.Persistence import DocumentManager
doc = DocumentManager.Instance.CurrentDBDocument

clr.AddReference('RevitAPI')
from Autodesk.Revit.DB import FamilyInstance, UnitUtils

# Units API detection
try:
    # Revit 2022+ ForgeTypeId units
    from Autodesk.Revit.DB import UnitTypeId
    HAS_FORGE_UNITS = True
except:
    from Autodesk.Revit.DB import DisplayUnitType
    HAS_FORGE_UNITS = False

clr.AddReference('RevitNodes')
import Revit
clr.ImportExtensions(Revit.Elements)

# -----------------------
# INPUTS
# -----------------------
elems_in = IN[0][0]  # list of family instances
if not isinstance(elems_in, list):
    elems_in = [elems_in]

out_dir = IN[1] if len(IN) > 1 and IN[1] else os.path.expanduser("~/Desktop")
name_prefix = IN[2] if len(IN) > 2 and IN[2] else "Wind"

# -----------------------
# Helpers (same style as your sample)
# -----------------------
def ensure_dir(p):
    if not p:
        raise Exception("Output directory path is required.")
    if not os.path.exists(p):
        os.makedirs(p)

def try_excel_com_available():
    """Return (excel_app, ExcelModule) or (None, None) if COM not available."""
    try:
        clr.AddReference('Microsoft.Office.Interop.Excel')
        from Microsoft.Office.Interop import Excel
        app = Excel.ApplicationClass()
        app.Visible = False
        app.DisplayAlerts = False
        return app, Excel
    except:
        return None, None

def save_workbook(app, Excel, filepath, header, data_rows):
    """Create one workbook, write header, then many data rows, save as .xlsx."""
    wb = None
    try:
        wb = app.Workbooks.Add()
        ws = wb.ActiveSheet

        # Header
        for c, h in enumerate(header, 1):
            ws.Cells(1, c).Value2 = h

        # Data rows
        for r, data in enumerate(data_rows, 2):  # start at row 2
            for c, v in enumerate(data, 1):
                ws.Cells(r, c).Value2 = v

        wb.SaveAs(filepath)
    finally:
        if wb is not None:
            wb.Close(SaveChanges=False)

def save_csv(filepath, header, data_rows):
    """Fallback: write one CSV with header + all rows."""
    import csv
    with open(filepath, mode='w', newline='') as f:
        w = csv.writer(f)
        w.writerow(header)
        for row in data_rows:
            w.writerow(row)

def write_one_file(excel_app, ExcelMod, base_path_no_ext, header, data_rows):
    """Write xlsx if Excel exists, else csv. Returns created_file path."""
    xlsx_path = base_path_no_ext + ".xlsx"
    csv_path  = base_path_no_ext + ".csv"

    if excel_app is not None:
        save_workbook(excel_app, ExcelMod, xlsx_path, header, data_rows)
        return xlsx_path
    else:
        save_csv(csv_path, header, data_rows)
        return csv_path

def get_param_str(e, name):
    p = e.LookupParameter(name)
    if p is None:
        return None
    s = p.AsString()
    if not s:
        try:
            s = p.AsValueString()
        except:
            s = None
    return s

def _parse_value_string_to_float(s):
    """
    Parse something like:
      "610.7 lb/ft" -> 610.7
      "12.95" -> 12.95
      "1,234.56 kips" -> 1234.56
    """
    if s is None:
        return None
    s = s.strip()
    if not s:
        return None
    # remove commas, extract first float-like token
    s = s.replace(",", "")
    m = re.search(r"[-+]?\d*\.?\d+(?:[eE][-+]?\d+)?", s)
    if not m:
        return None
    try:
        return float(m.group(0))
    except:
        return None

def _get_display_units_id(param):
    """
    Returns the unit id object if possible (ForgeTypeId in Revit 2022+),
    otherwise returns DisplayUnitType in older Revit, or None.
    """
    try:
        # Revit 2022+: Parameter.GetUnitTypeId()
        return param.GetUnitTypeId()
    except:
        pass

    # Older: might be param.DisplayUnitType (not always available depending on Revit version)
    try:
        return param.DisplayUnitType
    except:
        return None

def _convert_internal_to_param_display(param, v_internal):
    """
    Convert AsDouble internal value -> numeric in the parameter's *display unit*.
    This is the closest match to the value you see in Properties/RevitLookup.
    """
    # Try unit-aware conversion first
    units_id = _get_display_units_id(param)
    if units_id is not None:
        try:
            return UnitUtils.ConvertFromInternalUnits(v_internal, units_id)
        except:
            pass

    # Fallback: parse AsValueString
    try:
        return _parse_value_string_to_float(param.AsValueString())
    except:
        return None

def get_param_double(e, name, desired=None):
    """
    Returns the parameter value in desired units by:
      1) converting AsDouble() -> parameter display units (using GetUnitTypeId)
      2) converting from those display units into your requested output

    desired:
      - None      : returns in PARAM DISPLAY UNITS (matches what you see in UI)
      - "kip"     : returns kips
      - "kip/ft"  : returns kip/ft
    """
    p = e.LookupParameter(name)
    if p is None or (hasattr(p, "HasValue") and not p.HasValue):
        return None

    try:
        v_internal = p.AsDouble()
    except:
        v_internal = None

    # First: get the numeric value in the parameter's displayed units
    v_disp = None
    if v_internal is not None:
        v_disp = _convert_internal_to_param_display(p, v_internal)

    # If still None, try parse AsValueString anyway
    if v_disp is None:
        try:
            v_disp = _parse_value_string_to_float(p.AsValueString())
        except:
            v_disp = None

    if v_disp is None:
        return None

    if desired is None:
        return v_disp

    # Determine what the parameter's display unit *is* (string check is robust across versions)
    unit_id = _get_display_units_id(p)
    unit_str = str(unit_id).lower() if unit_id is not None else ""

    # Now convert from display units -> desired
    if desired == "kip":
        # If parameter is already in kips, return directly
        if "kips" in unit_str or "kip" in unit_str:
            return v_disp
        # If parameter is in pounds-force, convert to kips
        if "lb" in unit_str or "pound" in unit_str:
            return v_disp / 1000.0
        # Unknown: assume already kips
        return v_disp

    if desired == "kip/ft":
        # If already in kip/ft
        if ("kip" in unit_str and "foot" in unit_str) or ("kip" in unit_str and "/ft" in unit_str):
            return v_disp
        # If in lb/ft, convert to kip/ft
        if ("lb" in unit_str and "foot" in unit_str) or ("lb" in unit_str and "/ft" in unit_str) or ("pound" in unit_str and "foot" in unit_str):
            return v_disp / 1000.0
        # Unknown: assume lb/ft and convert
        return v_disp / 1000.0

    return v_disp

def safe_float(x, default=0.0):
    try:
        return float(x)
    except:
        return default

# -----------------------
# MAIN
# -----------------------
ensure_dir(out_dir)
view_name = doc.ActiveView.Name

# Unwrap
elems = [UnwrapElement(e) for e in elems_in]

# Geometry outputs (optional)
start_pts = []
lines = []

# Build rows
line_rows_X, line_rows_Y = [], []
pt_rows_X, pt_rows_Y     = [], []

OFFSET_FT = 0.5  # 6"

WindValues = []

for fi in elems:
    if not isinstance(fi, FamilyInstance):
        continue

    dir_xy = get_param_str(fi, "Shear Wall Direction")
    if not dir_xy:
        continue
    dir_xy = dir_xy.strip().upper()
    if dir_xy not in ["X", "Y"]:
        continue

    # Length (ft)
    length_param = fi.LookupParameter("Shearwall Length")
    if length_param is None:
        continue
    length_ft = length_param.AsDouble()

    # ---- FIXED UNIT PULLS ----
    # Wind PLF: want kip/ft (even though UI shows lb/ft)
    wind_plf = safe_float(get_param_double(fi, "Wind PLF", "kip/ft"), 0.0)

    # Optional force value: want kips (if your parameter is set up that way)
    wind_force = safe_float(get_param_double(fi, "Wind Force", "kip"), 0.0)
    WindValues.append(wind_force)

    # T_C Couple: UI shows kips; return kips (matches UI numeric)
    tc = safe_float(get_param_double(fi, "T_C Couple", "kip"), 0.0)

    # Transform-based geometry
    t = fi.GetTransform()
    origin = t.Origin
    direction = t.BasisX

    end_xyz = origin.Add(direction.Multiply(length_ft))

    # Dynamo geometry outputs
    start_pt_ds = Point.ByCoordinates(origin.X, origin.Y, origin.Z)
    end_pt_ds   = Point.ByCoordinates(end_xyz.X, end_xyz.Y, end_xyz.Z)
    start_pts.append(start_pt_ds)
    lines.append(Line.ByStartPointEndPoint(start_pt_ds, end_pt_ds))

    # -------- LINE LOAD ROW (Fx/Fy/Fz in kip/ft) --------
    # Wall axis direction projected to XY (unit vector)
    dx = float(direction.X)
    dy = float(direction.Y)

    mag = (dx*dx + dy*dy) ** 0.5
    if mag > 1e-9:
        ux = dx / mag
        uy = dy / mag
    else:
        ux = 0.0
        uy = 0.0

    # Resolve WindPLF into global components (assumes PLF is along wall axis)
    fx = wind_plf * ux
    fy = wind_plf * uy
    fz = 0.0

    row_line = [
        origin.X, origin.Y, origin.Z,
        end_xyz.X, end_xyz.Y, end_xyz.Z,
        fx, fy, fz,
        view_name
    ]

    # -------- POINT LOAD ROWS (offset 6" toward center), kips --------
    p1 = origin.Add(direction.Multiply(OFFSET_FT))          # inset from start
    p2 = end_xyz.Add(direction.Multiply(-OFFSET_FT))        # inset from end

    row_p1 = [p1.X, p1.Y, p1.Z, 0, 0, +tc, view_name]
    row_p2 = [p2.X, p2.Y, p2.Z, 0, 0, -tc, view_name]

    if dir_xy == "X":
        line_rows_X.append(row_line)
        pt_rows_X.append(row_p1)
        pt_rows_X.append(row_p2)
    else:
        line_rows_Y.append(row_line)
        pt_rows_Y.append(row_p1)
        pt_rows_Y.append(row_p2)

# Headers (line loads)
line_header = [
    "Start X (ft)", "Start Y (ft)", "Start Z (ft)",
    "End X (ft)",   "End Y (ft)",   "End Z (ft)",
    "Fx (kip/ft)", "Fy (kip/ft)", "Fz (kip/ft)",
    "VIEW_NAME"
]

# Headers (point loads)
point_header = [
    "X (ft)", "Y (ft)", "Z (ft)",
    "FX (kip)", "FY (kip)", "FZ (kip)",
    "VIEW_NAME"
]

created_files = []
errors = []

excel_app, ExcelMod = try_excel_com_available()
try:
    # Wind X line loads
    created_files.append(write_one_file(
        excel_app, ExcelMod,
        os.path.join(out_dir, "{} X".format(name_prefix)),
        line_header, line_rows_X
    ))

    # Wind Y line loads
    created_files.append(write_one_file(
        excel_app, ExcelMod,
        os.path.join(out_dir, "{} Y".format(name_prefix)),
        line_header, line_rows_Y
    ))

    # Wind X point loads
    created_files.append(write_one_file(
        excel_app, ExcelMod,
        os.path.join(out_dir, "{} X - PointLoads".format(name_prefix)),
        point_header, pt_rows_X
    ))

    # Wind Y point loads
    created_files.append(write_one_file(
        excel_app, ExcelMod,
        os.path.join(out_dir, "{} Y - PointLoads".format(name_prefix)),
        point_header, pt_rows_Y
    ))

except Exception as e:
    errors.append(str(e))
finally:
    if excel_app is not None:
        try:
            excel_app.Quit()
        except:
            pass

OUT = {
    "CreatedFiles": created_files,
    "Errors": errors,
    "StartPoints": start_pts,
    "Lines": lines,
    "Counts": {
        "X_line": len(line_rows_X),
        "Y_line": len(line_rows_Y),
        "X_point": len(pt_rows_X),
        "Y_point": len(pt_rows_Y)
    },
    "Wind Force (kip)": WindValues,
}
# ----------------------------------------
