# Dynamo graph Working Example.dyn (Dynamo 3.0.3.7597)

# group: User Selection
pick_model_elements = DSModelElementMultipleSelection()  # 3 picked in the model

# group: Reading Data and calculations
name = Element.Name(element=pick_model_elements)
code_block = CodeBlock { "vector family"; }
contains = List.Contains(list=name@L1, item=code_block)
filterByBoolMask = List.FilterByBoolMask(list=pick_model_elements, mask=contains)
code_block_2 = CodeBlock { "Force X"; }
getParameterValueByName = Element.GetParameterValueByName(element=filterByBoolMask.in, parameterName=code_block_2)
sum_of_x = CodeBlock(x=getParameterValueByName) { Math.Sum(x); }
code_block_3 = CodeBlock { "Force Y"; }
getParameterValueByName_2 = Element.GetParameterValueByName(element=filterByBoolMask.in, parameterName=code_block_3)
sum_of_y = CodeBlock(y=getParameterValueByName_2) { Math.Sum(y); }
force_location = Python(IN[0]=filterByBoolMask.in)  # CPython3
# ---------- force_location.python (35 lines) ----------
# Load the Python Standard and DesignScript Libraries
import sys
import clr
clr.AddReference('ProtoGeometry')
from Autodesk.DesignScript.Geometry import *

clr.AddReference('RevitAPI')
from Autodesk.Revit.DB import *

# Unwrap Dynamo elements to Revit API elements
# Unwrap Dynamo elements to Revit API elements
elements = UnwrapElement(IN[0])

# Ensure we are working with a list
if not isinstance(elements, list):
    elements = [elements]

output_points = []
x_values = []
y_values = []

for el in elements:
    loc = el.Location
    if isinstance(loc, LocationPoint):
        point = loc.Point
        output_points.append(f"Point: ({point.X}, {point.Y}, {point.Z})")
        x_values.append(point.X)
        y_values.append(point.Y)
    else:
        output_points.append("No LocationPoint")
        x_values.append(None)
        y_values.append(None)

# Output: [Formatted string], [X list], [Y list]
OUT = [output_points, x_values, y_values]
# ----------------------------------------
y_force_location = CodeBlock(x=force_location) { x[2]; }
sum_of_moment_location = Python(IN[0]=filterByBoolMask.out)  # CPython3; same code as force_location
x_moment_location = CodeBlock(y=sum_of_moment_location) { y[1]; }
y_delta = Python(IN[0]=y_force_location, IN[1]=x_moment_location)  # CPython3
# ---------- y_delta.python (18 lines) ----------
# Load the Python Standard and DesignScript Libraries
import sys
import clr
clr.AddReference('ProtoGeometry')
from Autodesk.DesignScript.Geometry import *

# The inputs to this node will be stored as a list in the IN variables.
dataEnteringNode = IN[0]
data2 = IN[1][0]

output = []
# Place your code below this line
for number in dataEnteringNode:
    output.append(number-data2)
    

# Assign your output to the OUT variable.
OUT = output
# ----------------------------------------
sum_of_moment_x_forces = CodeBlock(x=getParameterValueByName, y=y_delta) { x*y; }
x_force_location = CodeBlock(x=force_location) { x[1]; }
y_moment_location = CodeBlock(y=sum_of_moment_location) { y[2]; }
x_delta = Python(IN[0]=x_force_location, IN[1]=y_moment_location)  # CPython3; same code as y_delta
sum_of_moment_y_forces = CodeBlock(x=getParameterValueByName_2, y=x_delta) { x*y; }
sum_of_moments = CodeBlock(x=sum_of_moment_x_forces, y=sum_of_moment_y_forces) { -Math.Sum(x)+Math.Sum(y); }

# group: Write Data to Tag
code_block_4 = CodeBlock { "Sum Force X"; }
setParameterByName = Element.SetParameterByName(element=filterByBoolMask.out, parameterName=code_block_4, value=sum_of_x)
code_block_5 = CodeBlock { "Sum Force Y"; }
setParameterByName_2 = Element.SetParameterByName(element=filterByBoolMask.out, parameterName=code_block_5, value=sum_of_y)
code_block_6 = CodeBlock { "Sum of Moment"; }
setParameterByName_3 = Element.SetParameterByName(element=filterByBoolMask.out, parameterName=code_block_6, value=sum_of_moments)
